# Grasshopper definition TDDGH.gh (Grasshopper 1.0.7)

# ---- group: SpiralLines
crv = Curve()  # disabled

# ---- group: CenterLine
crv_2 = Curve()  # disabled

# ----
# Create Spiral Stair
length = Length()  # disabled
totalrotation = TotalRotation()  # disabled
dividenumber = DivideNumber()  # disabled
# 1. 入力と出力を決める
hight = Hight()  # disabled
centerline = CenterLine(crv_2)  # disabled
spirallines = SpiralLines(crv)  # disabled

# ---- group: Hight
num = Number(hight)  # disabled

# ---- group: Length
num_2 = Number(length)  # disabled

# ---- group: TotalRotation
num_3 = Number(totalrotation)  # disabled

# ---- group: NumberOfStairs
int = Integer(dividenumber)  # disabled

# ----
dividenumber_2 = DivideNumber()  # disabled

# ---- group: NumberOfStairs
int_2 = Integer(dividenumber_2)  # disabled

# ---- group: DividePoints
pt = Point()  # disabled

# ----
# Divide Center Line
centerline_2 = CenterLine()  # disabled
dividepoints = DividePoints(pt)  # disabled

# ---- group: CenterLine
crv_3 = Curve(centerline_2)  # disabled

crv_4 = Curve()  # disabled

# ----
# 2. いい感じにモジュールに分けて、それぞれテストのガラを書く
# Create Center Line
hight_2 = Hight()  # disabled
centerline_3 = CenterLine(crv_4)  # disabled

# ---- group: Hight
num_4 = Number(hight_2)  # disabled

# ---- group: SpiralLines
crv_5 = Curve()  # disabled

# ----
# Create Spiral Lines
length_2 = Length()  # disabled
totalrotation_2 = TotalRotation()  # disabled
hight_3 = Hight()  # disabled
dividedpoints = DividedPoints()  # disabled
spirallines_2 = SpiralLines(crv_5)  # disabled

# ---- group: Hight
num_5 = Number(hight_3)  # disabled

# ---- group: DividedPoints
pt_2 = Point(dividedpoints)  # disabled

# ---- group: Length
num_6 = Number(length_2)  # disabled

# ---- group: TotalRotation
num_7 = Number(totalrotation_2)  # disabled

# ---- group: DividePoints
pt_3 = Point()  # disabled

# ---- group: SpiralLinesExpected
crv_6 = Curve([<curve referenced from the Rhino model> x10])  # disabled

# ---- group: CenterLineExpected
crv_7 = Curve(<curve referenced from the Rhino model>)  # disabled

# ---- group: DividePointsExpected
geo = Geometry([<point referenced from the Rhino model> x11, <curve referenced from the Rhino model>])  # disabled

# ---- group: CenterLine
crv_8 = Curve()  # disabled

# ----
# Test Create Center Line
result = Result()  # disabled

# ----
# Test Create Spiral Lines
result_2 = Result()  # disabled

# ----
# Test Divide Center Line
result_3 = Result()  # disabled

panel = Panel("0")  # disabled
pt_4 = ConstructPoint(XCoordinate=panel, YCoordinate=panel, ZCoordinate=panel)  # disabled

# ---- group: DividePoints
pt_5 = Point()  # disabled

# ---- group: SpiralLinesExpected
crv_9 = Curve([<curve referenced from the Rhino model> x10])  # disabled

# ---- group: CenterLineExpected
crv_10 = Curve(<curve referenced from the Rhino model>)  # disabled

# ---- group: DividePointsExpected
geo_2 = Geometry([<point referenced from the Rhino model> x11, <curve referenced from the Rhino model>])  # disabled

# ---- group: CenterLine
crv_11 = Curve()  # disabled

# ----
# Test Divide Center Line
dist = Distance(PointA=pt_5, PointB=geo_2)  # disabled
ma = MassAddition(Input=dist)  # -> Result, PartialResults; disabled
expression = Expression(x=ma.Result, Expression="if(x<0.0001,\"Passed\",\"Failed\")")  # disabled
panel_2 = Panel(expression)  # disabled

# ----
# Test Create Spiral Lines
end = EndPoints()  # -> Start, End; disabled
end_2 = EndPoints(Curve=crv_9)  # -> Start, End; disabled
dist_2 = Distance(PointA=end.Start, PointB=end_2.Start)  # disabled
dist_3 = Distance(PointA=end.End, PointB=end_2.End)  # disabled
addition = Addition(A=dist_2, B=dist_3)  # disabled
expression_2 = Expression(x=addition, Expression="if(x<0.0001,\"Passed\",\"Failed\")")  # disabled
panel_3 = Panel(expression_2)  # disabled

# ----
# Test Create Center Line
end_3 = EndPoints(Curve=crv_11)  # -> Start, End; disabled
end_4 = EndPoints(Curve=crv_10)  # -> Start, End; disabled
dist_4 = Distance(PointA=end_3.Start, PointB=end_4.Start)  # disabled
dist_5 = Distance(PointA=end_3.End, PointB=end_4.End)  # disabled
addition_2 = Addition(A=dist_4, B=dist_5)  # disabled
expression_3 = Expression(x=addition_2, Expression="if(x<0.0001,\"Passed\",\"Failed\")")  # disabled
panel_4 = Panel(expression_3)  # disabled

# ----
# 4. クラスター化してテストの実行をする
panel_5 = Panel("70")  # disabled
panel_6 = Panel("2*PI")  # disabled
panel_7 = Panel("10")  # disabled
panel_8 = Panel("70")  # disabled

# ---- group: Hight
num_8 = Number(panel_5)  # disabled

# ---- group: DividedPoints
pt_6 = Point([Point(0, 0, 0), Point(0, 0, 7), Point(0, 0, 14), Point(0, 0, 21), Point(0, 0, 28), Point(0, 0, 35), Point(0, 0, 42), Point(0, 0, 49), Point(0, 0, 56), Point(0, 0, 63), Point(0, 0, 70)])  # disabled

# ---- group: CenterLineExpected
crv_12 = Curve(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)  # disabled

# ---- group: Length
num_9 = Number(panel_8)  # disabled

# ---- group: TotalRotation
num_10 = Number(panel_6)  # disabled

# ---- group: SpiralLinesExpected
crv_13 = Curve([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])  # disabled

# ---- group: CenterLine
crv_14 = Curve(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)  # disabled

# ---- group: NumberOfStairs
int_3 = Integer(panel_7)  # disabled

# ---- group: DividePointsExpected
geo_3 = Geometry([Point(0, 0, 0), Point(0, 0, 7), Point(0, 0, 14), Point(0, 0, 21), Point(0, 0, 28), Point(0, 0, 35), Point(0, 0, 42), Point(0, 0, 49), Point(0, 0, 56), Point(0, 0, 63), Point(0, 0, 70)])  # disabled

# ----
# Create Center Line
cluster = Cluster(hight=num_8)  # disabled

# ----
# Divide Center Line
cluster_2 = Cluster_2(centerline=crv_14, dividenumber=int_3)  # disabled

# ----
# Create Spiral Lines
cluster_3 = Cluster_3(dividedpoints=pt_6, length=num_9, totalrotation=num_10)  # disabled

# ----
# Test Create Center Line
cluster_4 = Cluster_4(centerline=cluster, centerlineexpected=crv_12)  # disabled

# ----
# Test Divide Center Line
cluster_5 = Cluster_5(pt=cluster_2, dividepointsexpected=geo_3)  # disabled

# ----
# Test Create Spiral Lines
cluster_6 = Cluster_6(spirallines=cluster_3, spirallinesexpected=crv_13)  # disabled

panel_9 = Panel(cluster_4)  # disabled
panel_10 = Panel(cluster_5)  # disabled
panel_11 = Panel(cluster_6)  # disabled
dividenumber_3 = DivideNumber()  # disabled

# ---- group: NumberOfStairs
int_4 = Integer(dividenumber_3)  # disabled

# ----
# Create Spiral Stair
number_slider = Slider(100, range=0..100)  # disabled
number_slider_2 = Slider(100, range=0..100)  # disabled
number_slider_3 = Slider(2, range=0..2)  # disabled
number_slider_4 = Slider(10, range=0..10)  # disabled
pi = Pi(Factor=number_slider_3)  # disabled
staircreatorcluster = StairCreatorCluster(hight=number_slider, length=number_slider_2, totalrotation=pi, dividenumber=number_slider_4)  # -> centerline, spirallines; disabled

# ----
# Divide Center Line
centerline_4 = CenterLine()  # disabled
dividenumber_4 = DivideNumber()  # disabled

# ---- group: NumberOfStairs
int_5 = Integer(dividenumber_4)  # disabled

# ---- group: CenterLine
crv_15 = Curve(centerline_4)  # disabled

# ----
divide = DivideCurve(Curve=crv_15, Count=int_5, Kinks=False)  # -> Points, Tangents, Parameters; disabled

# ---- group: DividedPoints
pt_7 = Point(divide.Points)  # disabled

# ----
dividepoints_2 = DividePoints(pt_7)  # disabled

# ----
# 3. 実装とテストを書く
# Create Center Line
hight_4 = Hight()  # disabled

# ---- group: Hight
num_11 = Number(hight_4)  # disabled

# ----
Z = UnitZ(Factor=num_11)  # disabled
move = Move(Geometry=pt_4, Motion=Z)  # -> Geometry, Transform; disabled
ln = Line(StartPoint=pt_4, EndPoint=move.Geometry)  # disabled

# ---- group: CenterLine
crv_16 = Curve(ln)  # disabled

# ----
centerline_5 = CenterLine(crv_16)  # disabled

# ----
# Create Spiral Lines
length_3 = Length()  # disabled
dividedpoints_2 = DividedPoints()  # disabled
totalrotation_3 = TotalRotation()  # disabled

# ---- group: DividedPoints
pt_8 = Point(dividedpoints_2)  # disabled

# ---- group: Length
num_12 = Number(length_3)  # disabled

# ---- group: TotalRotation
num_13 = Number(totalrotation_3)  # disabled

# ----
cull_i = CullIndex(List=pt_8, Indices=0, Wrap=True)  # disabled
lng = ListLength(List=cull_i)  # disabled
X = UnitX(Factor=num_12)  # disabled
division = Division(A=num_13, B=lng)  # disabled
move_2 = Move(Geometry=cull_i, Motion=X)  # -> Geometry, Transform; disabled
series = Series(Start=0, Step=division, Count=lng)  # disabled
rotate = Rotate(Geometry=move_2.Geometry, Angle=series, Plane=PlaneXY(0, 0, 0))  # -> Geometry, Transform; disabled
ln_2 = Line(StartPoint=cull_i, EndPoint=rotate.Geometry)  # disabled

# ---- group: SpiralLines
crv_17 = Curve(ln_2)  # disabled

# ----
spirallines_3 = SpiralLines(crv_17)  # disabled

# ----
# Create Spiral Stair
length_4 = Length()  # disabled
totalrotation_4 = TotalRotation()  # disabled
# 5.各モジュールを組み合わせてコンポーネントにする
hight_5 = Hight()  # disabled

# ---- group: Hight
num_14 = Number(hight_5)  # disabled

# ---- group: Length
num_15 = Number(length_4)  # disabled

# ---- group: TotalRotation
num_16 = Number(totalrotation_4)  # disabled

# ----
cluster_7 = Cluster(hight=num_14)  # disabled
cluster_8 = Cluster_2(centerline=cluster_7, dividenumber=int_4)  # disabled
cluster_9 = Cluster_3(dividedpoints=cluster_8, length=num_15, totalrotation=num_16)  # disabled

# ---- group: SpiralLines
crv_18 = Curve(cluster_9)  # disabled

# ---- group: CenterLine
crv_19 = Curve(cluster_7)  # disabled

# ----
centerline_6 = CenterLine(crv_19)  # disabled
spirallines_4 = SpiralLines(crv_18)  # disabled

# ==== cluster Cluster
pt = ConstructPoint(XCoordinate="0", YCoordinate="0", ZCoordinate="0")

# ----
# Create Center Line
hight = ClusterInput()

# ---- group: Hight
num = Number(hight)

# ----
Z = UnitZ(Factor=num)
move = Move(Geometry=pt, Motion=Z)  # -> Geometry, Transform
ln = Line(StartPoint=pt, EndPoint=move.Geometry)

# ---- group: CenterLine
crv = Curve(ln)

# ----
centerline = ClusterOutput(crv)

# ==== cluster Cluster_2

# ----
# Divide Center Line
centerline = ClusterInput()
dividenumber = ClusterInput()

# ---- group: NumberOfStairs
int = Integer(dividenumber)

# ---- group: CenterLine
crv = Curve(centerline)

# ----
divide = DivideCurve(Curve=crv, Count=int, Kinks=False)  # -> Points, Tangents, Parameters

# ---- group: DividedPoints
pt = Point(divide.Points)

# ----
dividepoints = ClusterOutput(pt)

# ==== cluster Cluster_3

# ----
# Create Spiral Lines
length = ClusterInput()
dividedpoints = ClusterInput()
totalrotation = ClusterInput()

# ---- group: Length
num = Number(length)

# ---- group: DividedPoints
pt = Point(dividedpoints)

# ---- group: TotalRotation
num_2 = Number(totalrotation)

# ----
cull_i = CullIndex(List=pt, Indices=0, Wrap=True)
lng = ListLength(List=cull_i)
X = UnitX(Factor=num)
division = Division(A=num_2, B=lng)
move = Move(Geometry=cull_i, Motion=X)  # -> Geometry, Transform
series = Series(Start=0, Step=division, Count=lng)
rotate = Rotate(Geometry=move.Geometry, Angle=series, Plane=PlaneXY(0, 0, 0))  # -> Geometry, Transform
ln = Line(StartPoint=cull_i, EndPoint=rotate.Geometry)

# ---- group: SpiralLines
crv = Curve(ln)

# ----
spirallines = ClusterOutput(crv)

# ==== cluster Cluster_4
centerlineexpected = ClusterInput()

# ---- group: CenterLineExpected
crv = Curve(centerlineexpected)

# ----
# Test Create Center Line
centerline = ClusterInput()
end = EndPoints(Curve=crv)  # -> Start, End

# ---- group: CenterLine
crv_2 = Curve(centerline)

# ----
end_2 = EndPoints(Curve=crv_2)  # -> Start, End
dist = Distance(PointA=end_2.Start, PointB=end.Start)
dist_2 = Distance(PointA=end_2.End, PointB=end.End)
addition = Addition(A=dist, B=dist_2)
expression = Expression(x=addition, Expression="if(x<0.0001,\"Passed\",\"Failed\")")
panel = Panel(expression)
result = ClusterOutput(expression)

# ==== cluster Cluster_5
dividepointsexpected = ClusterInput()
pt = ClusterInput()

# ---- group: DividedPoints
pt_2 = Point(pt)

# ---- group: DividePointsExpected
geo = Geometry(dividepointsexpected)

# ----
# Test Divide Center Line
dist = Distance(PointA=pt_2, PointB=geo)
ma = MassAddition(Input=dist)  # -> Result, PartialResults
expression = Expression(x=ma.Result, Expression="if(x<0.0001,\"Passed\",\"Failed\")")
panel = Panel(expression)

result = ClusterOutput(expression)

# ==== cluster Cluster_6
spirallines = ClusterInput()
spirallinesexpected = ClusterInput()

# ---- group: SpiralLinesExpected
crv = Curve(spirallinesexpected)

# ----
# Test Create Spiral Lines
end = EndPoints(Curve=spirallines)  # -> Start, End
end_2 = EndPoints(Curve=crv)  # -> Start, End
dist = Distance(PointA=end.Start, PointB=end_2.Start)
dist_2 = Distance(PointA=end.End, PointB=end_2.End)
addition = Addition(A=dist, B=dist_2)

ma = MassAddition(Input=addition)  # -> Result, PartialResults

expression = Expression(x=ma.Result, Expression="if(x<0.0001,\"Passed\",\"Failed\")")
panel = Panel(expression)

result = ClusterOutput(expression)

# ==== cluster StairCreatorCluster
dividenumber = ClusterInput()

# ---- group: NumberOfStairs
int = Integer(dividenumber)

# ----
# Create Spiral Stair
length = ClusterInput()
totalrotation = ClusterInput()
hight = ClusterInput()

# ---- group: Hight
num = Number(hight)

# ---- group: Length
num_2 = Number(length)

# ---- group: TotalRotation
num_3 = Number(totalrotation)

# ----
cluster = Cluster(hight=num)
cluster_2 = Cluster_2(centerline=cluster, dividenumber=int)
cluster_3 = Cluster_3(dividedpoints=cluster_2, length=num_2, totalrotation=num_3)

# ---- group: SpiralLines
crv = Curve(cluster_3)

# ---- group: CenterLine
crv_2 = Curve(cluster)

# ----
centerline = ClusterOutput(crv_2)
spirallines = ClusterOutput(crv)
